# Dynamo graph drawdirectverts.dyn (Dynamo 2.14.0.3747)
# packages: Dynamo Shader Toy 1.0.0

code_block = CodeBlock()
# ---------- code_block.designscript (4 lines) ----------
[Vector.ByCoordinates(0,0,0),
Vector.ByCoordinates(0,0,0),
Vector.ByCoordinates(0,0,0)
];
# ----------------------------------------
byCenterPointRadius = Sphere.ByCenterPointRadius()
tessellate = DynamoShaderNodes.ShadeGeometry.Tessellate(geo=byCenterPointRadius)
code_block_2 = CodeBlock { 4; }
code_block_3 = CodeBlock { 1; }
takeEveryNthItem = List.TakeEveryNthItem(list=tessellate, n=code_block_2, offset=code_block_3)
code_block_4 = CodeBlock { 16; }
code_block_5 = CodeBlock()
# ---------- code_block_5.designscript (13 lines) ----------
"
struct PixelInputType
{
    float4 position : SV_POSITION;
};
////////////////////////////////////////////////////////////////////////////////
// Pixel Shader
////////////////////////////////////////////////////////////////////////////////
float4 main(PixelInputType input) : SV_TARGET
{
    return float4(1,.3,.7,1.0);
}
";
# ----------------------------------------
code_block_6 = CodeBlock()
# ---------- code_block_6.designscript (35 lines) ----------
"
cbuffer MatrixBuffer
{
    matrix worldMatrix;
    matrix viewMatrix;
    matrix projectionMatrix;
};
//////////////
// TYPEDEFS //
//////////////
struct VertexInputType
{
    float4 position : POSITION;
};

struct PixelInputType
{
    float4 position : SV_POSITION;

};

////////////////////////////////////////////////////////////////////////////////
// Vertex Shader
////////////////////////////////////////////////////////////////////////////////
PixelInputType main(VertexInputType input)
{
 PixelInputType output;
    // Calculate the position of the vertex against the world, view, and projection matrices.
   output.position = mul(input.position, worldMatrix);
   output.position = mul(output.position, viewMatrix);
   output.position = mul(output.position, projectionMatrix);
   return output;
}

";
# ----------------------------------------
code_block_7 = CodeBlock { "matrixbuffer"; ["w","v","p"]; }
code_block_8 = CodeBlock { Vector.ByCoordinates(2,2,4); Vector.ByCoordinates(0,0,0); Vector.ByCoordinates(0,1,0); Vector.ByCoordinates(0,0,1); }
createWorld = DynamoShaderNodes.Numerics.NumericExtensions.CreateWorld(position=code_block_8.out1, forward=code_block_8.out2, up=code_block_8.out3)
transpose = DynamoShaderNodes.Numerics.NumericExtensions.Transpose(mat=createWorld)
createLookAt = DynamoShaderNodes.Numerics.NumericExtensions.CreateLookAt(cameraPosition=code_block_8.out0, cameraTarget=code_block_8.out1, cameraUpVector=code_block_8.out3)
transpose_2 = DynamoShaderNodes.Numerics.NumericExtensions.Transpose(mat=createLookAt)
code_block_9 = CodeBlock { 60; 0.1; 256; }
code_block_10 = CodeBlock { a = 1024; b = 1024; a/b; }
createPerspectiveProjection = DynamoShaderNodes.Numerics.NumericExtensions.CreatePerspectiveProjection(fov_degrees=code_block_9.out0, aspectRatio=code_block_10.out2, near=code_block_9.out1, far=code_block_9.out2)
transpose_3 = DynamoShaderNodes.Numerics.NumericExtensions.Transpose(mat=createPerspectiveProjection)
code_block_11 = CodeBlock(w=transpose, v=transpose_2, p=transpose_3) { [w,v,p]; }
byNameAndDataList = DynamoShaderNodes.UniformBufferData.ByNameAndDataList(name=code_block_7.out0, fieldNames=code_block_7.out1, fieldValues=code_block_11)
byShadersAndVertexData = DynamoShaderNodes.ShadeData.ByShadersAndVertexData(vertexData=takeEveryNthItem, vertexSizeInBytes=code_block_4, pixel=code_block_5, vertex=code_block_6, constantBufferData=byNameAndDataList, width=code_block_10.a, height=code_block_10.b)
watch_image = WatchImageCore(image=byShadersAndVertexData)
