# Dynamo graph rendershphere_simpleshader.dyn (Dynamo 2.14.0.3747)
# packages: Dynamo Shader Toy 1.0.0

byCenterPointRadius = Sphere.ByCenterPointRadius()
code_block = CodeBlock()
# ---------- code_block.designscript (13 lines) ----------
"
struct PixelInputType
{
    float4 position : SV_POSITION;
};
////////////////////////////////////////////////////////////////////////////////
// Pixel Shader
////////////////////////////////////////////////////////////////////////////////
float4 main(PixelInputType input) : SV_TARGET
{
    return float4(1,.3,.7,1.0);
}
";
# ----------------------------------------
code_block_2 = CodeBlock()
# ---------- code_block_2.designscript (35 lines) ----------
"
cbuffer MatrixBuffer
{
    matrix worldMatrix;
    matrix viewMatrix;
    matrix projectionMatrix;
};
//////////////
// TYPEDEFS //
//////////////
struct VertexInputType
{
    float4 position : POSITION;
};

struct PixelInputType
{
    float4 position : SV_POSITION;

};

////////////////////////////////////////////////////////////////////////////////
// Vertex Shader
////////////////////////////////////////////////////////////////////////////////
PixelInputType main(VertexInputType input)
{
 PixelInputType output;
    // Calculate the position of the vertex against the world, view, and projection matrices.
   output.position = mul(input.position, worldMatrix);
   output.position = mul(output.position, viewMatrix);
   output.position = mul(output.position, projectionMatrix);
   return output;
}

";
# ----------------------------------------
code_block_3 = CodeBlock { {}; }
code_block_4 = CodeBlock { 800; 600; }
byShadersAndData = DynamoShaderNodes.ShadeGeometry.ByShadersAndData(geo=byCenterPointRadius, pixel=code_block, vertex=code_block_2, constantBufferData=code_block_3, width=code_block_4.out0, height=code_block_4.out1)
watch_image = WatchImageCore(image=byShadersAndData)
