# Dynamo graph shading with normals.dyn (Dynamo 2.14.0.3747)
# packages: Dynamo Shader Toy 1.0.0

code_block = CodeBlock { -1..1; }
byCoordinates = Point.ByCoordinates(x=code_block, y=code_block, z=code_block, lacing=CrossProduct)
code_block_2 = CodeBlock { 0.7; }
byCenterPointRadius = Sphere.ByCenterPointRadius(centerPoint=byCoordinates, radius=code_block_2)
flatten = List.Flatten(list=byCenterPointRadius)
code_block_3 = CodeBlock()
# ---------- code_block_3.designscript (14 lines) ----------
"
struct PixelInputType
{
    float4 position : SV_POSITION;
    float4 c : COLOR;
};
////////////////////////////////////////////////////////////////////////////////
// Pixel Shader
////////////////////////////////////////////////////////////////////////////////
float4 main(PixelInputType input) : SV_TARGET
{
    return clamp(((dot(input.c,normalize(float4(.5,.2,0,1))*.8)) + 1.0)/2.0,0,1);
}
";
# ----------------------------------------
code_block_4 = CodeBlock()
# ---------- code_block_4.designscript (40 lines) ----------
"
cbuffer MatrixBuffer
{
    matrix worldMatrix;
    matrix viewMatrix;
    matrix projectionMatrix;
};
//////////////
// TYPEDEFS //
//////////////
struct VertexInputType
{
    float4 position : POSITION;
float4 color : COLOR;
float4 norm : NORMAL;
float4 position4 : POSITION1;
};

struct PixelInputType
{
    float4 position : SV_POSITION;

float4 c : COLOR;
};

////////////////////////////////////////////////////////////////////////////////
// Vertex Shader
////////////////////////////////////////////////////////////////////////////////
PixelInputType main(VertexInputType input)
{
 PixelInputType output;
    // Calculate the position of the vertex against the world, view, and projection matrices.
   output.position = mul(input.position, worldMatrix);
   output.position = mul(output.position, viewMatrix);
   output.position = mul(output.position, projectionMatrix);
   output.c = input.norm;
   return output;
}

";
# ----------------------------------------
code_block_5 = CodeBlock { "matrixbuffer"; ["w","v","p"]; }
code_block_6 = CodeBlock { Vector.ByCoordinates(2,2,4); Vector.ByCoordinates(0,0,0); Vector.ByCoordinates(0,1,0); Vector.ByCoordinates(0,0,1); }
createWorld = DynamoShaderNodes.Numerics.NumericExtensions.CreateWorld(position=code_block_6.out1, forward=code_block_6.out3, up=code_block_6.out2)
transpose = DynamoShaderNodes.Numerics.NumericExtensions.Transpose(mat=createWorld)
createLookAt = DynamoShaderNodes.Numerics.NumericExtensions.CreateLookAt(cameraPosition=code_block_6.out0, cameraTarget=code_block_6.out1, cameraUpVector=code_block_6.out2)
transpose_2 = DynamoShaderNodes.Numerics.NumericExtensions.Transpose(mat=createLookAt)
code_block_7 = CodeBlock { 60; }
code_block_8 = CodeBlock { 1024; 1024; }
code_block_9 = CodeBlock(a=code_block_8.out0, b=code_block_8.out1) { a/b; }
code_block_10 = CodeBlock { 0.1; 256; }
createPerspectiveProjection = DynamoShaderNodes.Numerics.NumericExtensions.CreatePerspectiveProjection(fov_degrees=code_block_7, aspectRatio=code_block_9, near=code_block_10.out0, far=code_block_10.out1)
transpose_3 = DynamoShaderNodes.Numerics.NumericExtensions.Transpose(mat=createPerspectiveProjection)
code_block_11 = CodeBlock(w=transpose, v=transpose_2, p=transpose_3) { [w,v,p]; }
byNameAndDataList = DynamoShaderNodes.UniformBufferData.ByNameAndDataList(name=code_block_5.out0, fieldNames=code_block_5.out1, fieldValues=code_block_11)
byShadersAndData = DynamoShaderNodes.ShadeGeometry.ByShadersAndData(geo=flatten, pixel=code_block_3, vertex=code_block_4, constantBufferData=byNameAndDataList, width=code_block_8.out0, height=code_block_8.out1)
watch_image = WatchImageCore(image=byShadersAndData)
