# Dynamo graph structgeneration.dyn (Dynamo 2.14.0.3747)
# packages: Dynamo Shader Toy 1.0.0

code_block = CodeBlock { "mat"; }
code_block_2 = CodeBlock { 50; }
code_block_3 = CodeBlock { 4/3; }
code_block_4 = CodeBlock { 0.1; 100; }
createPespectiveProjection = DynamoShaderNodes.Numerics.NumericExtensions.CreatePespectiveProjection(fov_degrees=code_block_2, aspectRatio=code_block_3, near=code_block_4.out0, far=code_block_4.out1)
code_block_5 = CodeBlock(a=createPespectiveProjection) { [a]; }
byNameAndDataList = DynamoShaderNodes.UniformBufferData.ByNameAndDataList(name=code_block, data=code_block_5)
